# Grasshopper definition A_single_box_annualdaylightinganalysis_honeybee.gh (Grasshopper 1.0.7)

number_slider = Slider(10, range=0..10)
rectangle = Rectangle(Plane=PlaneXY(0, 0, 0), XSize=number_slider, YSize=number_slider, Radius=0)  # -> Rectangle, Length
unit_z = UnitZ(Factor=Slider(3, range=0..10))
box_rectangle = BoxRectangle(Rectangle=rectangle.Rectangle, Height=unit_z)

# ----
# Surroundings
xy_plane = XYPlane(Origin=Point(0, 0, 0))
number_slider_2 = Slider(15, range=0..100)
center_box = CenterBox(Base=xy_plane, X=number_slider_2, Y=number_slider_2, Z="0")
construct_domain = ConstructDomain(DomainStart=Slider(18, range=0..30), DomainEnd=Slider(28, range=0..30))
deconstruct_brep = DeconstructBrep(Brep=center_box)  # -> Faces, Edges, Vertices
number_slider_3 = Slider(8, range=0..10)
random = Random(Range=construct_domain, Number=Slider(4, range=0..10), Seed=Slider(7, range=0..10))
point = Point(deconstruct_brep.Vertices)
rectangle_2 = Rectangle(Plane=point, XSize=number_slider_3, YSize=number_slider_3, Radius=0)  # -> Rectangle, Length
sort_list = SortList(Keys=rectangle_2.Rectangle, ValuesA=random)  # -> Keys, ValuesA
unit_z_2 = UnitZ(Factor=sort_list.ValuesA)
box_rectangle_2 = BoxRectangle(Rectangle=rectangle_2.Rectangle, Height=unit_z_2)
context = Brep(box_rectangle_2)

# ----
# windows
number_slider_4 = Slider(0, range=0..5)
deconstruct_brep_2 = DeconstructBrep(Brep=box_rectangle)  # -> Faces, Edges, Vertices
list_item = ListItem(List=deconstruct_brep_2.Faces, Index=number_slider_4, Wrap=True)
negative = Negative(Value=Slider(1, range=0..1))
curve = Curve(list_item)
offset_curve = OffsetCurve(Curve=curve, Distance=negative, Plane=list_item, Corners=1)
vector_xyz = VectorXYZ(XComponent=Slider(0.65, range=0..1), YComponent=Slider(0.51, range=0..1), ZComponent=0)  # -> Vector, Length
vector_xyz_2 = VectorXYZ(XComponent=Slider(0.35, range=0..1), YComponent=Slider(0.79, range=0..1), ZComponent=0)  # -> Vector, Length
evaluate_surface = EvaluateSurface(Surface=reparameterize(offset_curve), Point=vector_xyz.Vector)  # -> Point, Normal, UDirection, VDirection, Frame
evaluate_surface_2 = EvaluateSurface(Surface=reparameterize(offset_curve), Point=vector_xyz_2.Vector)  # -> Point, Normal, UDirection, VDirection, Frame
center_box_2 = CenterBox(Base=evaluate_surface_2.Point, X=Slider(0.5, range=0..1), Y="0", Z=Slider(0.68, range=0..1))
center_box_3 = CenterBox(Base=evaluate_surface.Point, X=Slider(0.45, range=0..1), Y="0", Z=Slider(0.92, range=0..1))

# ----
# Frontdoor plan
rectangle_3 = Rectangle(Plane=PlaneXY(0, 0, 0), XSize=number_slider, YSize=number_slider, Radius=0)  # -> Rectangle, Length
xz_plane = XZPlane(Origin=Point(0, 0, 0))
mirror = Mirror(Geometry=rectangle_3.Rectangle, Plane=xz_plane)  # -> Geometry, Transform
infront_floor = Surface(mirror.Geometry)
face = HBFace(geo=infront_floor)  # -> out, faces; plug-in component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

deconstruct_brep_3 = DeconstructBrep(Brep=box_rectangle)  # -> Faces, Edges, Vertices
list_item_2 = ListItem(List=deconstruct_brep_3.Faces, Index=Slider(4, range=0..5), Wrap=True)
genpts = LBGeneratePointGrid(geometry=list_item_2, grid_size=Slider(2.01, range=0..5))  # -> points, vectors, face_areas, graft(mesh); plug-in component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
sensorgrid = HBSensorGrid(positions=genpts.points, directions=genpts.vectors)  # -> grid; plug-in component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

# ----
# Weather Data
panel = Panel("http://climate.onebuilding.org/WMO_Region_5_Southwest_Pacific/SGP_Singapore/SGP_SG_Paya.Lebar.AB.486940_TMYx.zip")
downloadepw = LBDownloadWeather(weather_URL=panel)  # -> epw_file, stat_file, ddy_file; plug-in component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
wea = HBWeaFromEPW(epw_file=downloadepw.epw_file)  # -> wea; plug-in component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

# ----
# shadings
number_slider_5 = Slider(2, range=0..7)
negative_2 = Negative(Value=Slider(0.553, range=0..1))
unit_y = UnitY(Factor=negative_2)
negative_3 = Negative(Value=Slider(0, range=0..90))

# ----
# Model with elements
windows = Surface([center_box_3, center_box_2])
roomsolid = HBRoomFromSolid(geo=flatten(box_rectangle), name="box", conditioned=True)  # -> out, rooms; plug-in component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
aperture = HBAperture(geo=windows, name="windows")  # -> out, apertures; plug-in component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
louvershades = HBLouverShades(
    hb_objs=flatten(aperture.apertures),
    depth=Slider(0.2, range=0..10),
    dist_between=Slider(0.2, range=0..10),
    vertical=Toggle(True))  # -> readMe, hb_objs; plug-in component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
shade = HBShade(geo=context)  # -> out, shades; plug-in component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

deconstruct_brep_4 = DeconstructBrep(Brep=windows)  # -> Faces, Edges, Vertices
list_item_3 = ListItem(List=deconstruct_brep_4.Edges, Index=number_slider_5, Wrap=True)
line = Line(list_item_3)
move = Move(Geometry=line, Motion=unit_y)  # -> Geometry, Transform
loft = Loft(
    Curves=[move.Geometry, line],
    Options={Adjust=False, Closed=False, LoftEnds=0, LoftSimp=0, LoftType=0, Rebuild=10, Refit=0.01})
rotate = Rotate(Geometry=loft, Angle=degrees(negative_3), Plane=line)  # -> Geometry, Transform

shades = Brep(rotate.Geometry)
shade_2 = HBShade(geo=shades)  # -> out, shades; plug-in component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
addshade = HBAddShade(hb_obj=roomsolid.rooms, out_shades=flatten(shade_2.shades))  # -> hb_obj; plug-in component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
addsubface = HBAddSubface(hb_obj=flatten(addshade), sub_faces=flatten(louvershades.hb_objs))  # -> hb_obj; plug-in component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
bordershades = HBExtrudedBorderShades(hb_objs=flatten(addsubface), depth=Slider(0.2, range=0..10))  # -> out, hb_objs; plug-in component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
model = HBModel(rooms=flatten(bordershades.hb_objs), shades=flatten(shade.shades), name="newhouse")  # -> out, model; plug-in component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

vizwiref = HBVizualizeWireframe(hb_objs=flatten(model.model))  # -> geo; plug-in component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

# ----
# Gridmaking/Daylightanalysis/Heatmap
gridrooms = HBSensorGridFromRooms(rooms=bordershades.hb_objs, grid_size=Slider(0.264, range=0..5), dist_floor=Slider(0.303, range=0..1))  # -> grid, points, mesh; plug-in component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
assigngridsviews = HBAssignGridsAndViews(model=model.model, grids=flatten(gridrooms.grid))  # -> model; plug-in component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
annualdaylight = HBAnnualDaylight(
    model=assigngridsviews,
    wea=wea,
    north=Slider(31, range=0..100),
    sensor_count=Slider(40, range=0..100),
    radiance_parameters=" ")  # -> recipe; plug-in component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
runrecipe = HBRunRecipe(
    recipe=annualdaylight,
    cpu_count=Slider(5, range=0..10),
    reload_old=Toggle(False),
    report_out=Toggle(False),
    run=Toggle(False))  # -> out, results; plug-in component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
annualmetrics = HBAnnualDaylightMetrics(results=runrecipe.results, threshold="400")  # -> out, DA, UDI; plug-in component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
mjoin = MeshJoin(Meshes=gridrooms.mesh)
data = Data(flatten(annualmetrics.DA))
heatmap = LBSpatialHeatmap(values=data, mesh=mjoin)  # -> mesh, legend, title, colors, legend_par; plug-in component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
